# Grasshopper definition BDL3_x.gh (Grasshopper 1.0.7)
# plug-ins: Rhino.Inside for Autodesk Revit, Human, CORE.Toolbox.Grasshopper, Wombat, Bifocals

categories = BuiltInCategories("autodesk.revit.category.local:walls-1.0.0", SearchPattern="Walls")
levels = LevelsPicker(<levels picker referenced from the Revit model>)
levels_2 = LevelsPicker(<levels picker referenced from the Revit model>)
levels_3 = LevelsPicker(<levels picker referenced from the Revit model>)
element_type_picker = ElementTypePicker(
    categories,
    {"Basic Wall : Exterior - Block on Mtl. Stud": "f2c11db4-bcd8-4ff1-9607-80f944683cd0:f8dc8733-6ca1-4a9e-bd25-3e0787704d28-000126b7", "Basic Wall : Exterior - CMU on Brick 370mm 1": "f2c11db4-bcd8-4ff1-9607-80f944683cd0:f7a44ea8-20d4-4b4c-bee2-4a9d515d56a0-000330f4", "Curtain Wall : Curtain Wall": "f2c11db4-bcd8-4ff1-9607-80f944683cd0:cb74be9d-0c49-4127-96a8-1de4e3dd00ba-00005979", "Curtain Wall : Exterior Glazing": "f2c11db4-bcd8-4ff1-9607-80f944683cd0:22712c68-ecc0-4fdf-bdbb-929626510e37-0000c6f7", "Curtain Wall : Storefront": "f2c11db4-bcd8-4ff1-9607-80f944683cd0:22712c68-ecc0-4fdf-bdbb-929626510e37-0000c6f8"}, selected="Basic Wall : Exterior - CMU on Brick 370mm 1")
levelfltr = LevelFilter(Levels=levels_2, Inverted=False)
levelfltr_2 = LevelFilter(Levels=levels_3, Inverted=False)
levelfltr_3 = LevelFilter(Levels=levels, Inverted=False)
typefltr = TypeFilter(Types=element_type_picker, Inverted=False)
andfltr = LogicalAndFilter(FilterA=typefltr, FilterB=levelfltr_2)
andfltr_2 = LogicalAndFilter(FilterA=typefltr, FilterB=levelfltr)
andfltr_3 = LogicalAndFilter(FilterA=typefltr, FilterB=levelfltr_3)
elements = QueryElements(Filter=andfltr_3, Limit="2")  # -> Elements, Count
elements_2 = QueryElements(Filter=andfltr, Limit="1")  # -> Elements, Count
elements_3 = QueryElements(Filter=andfltr_2, Limit="1")  # -> Elements, Count
split = SplitList(List=elements.Elements, Index="1")  # -> ListA, ListB
inspect = InspectElement(Element=elements_2.Elements)
inspect_2 = InspectElement(Element=elements_3.Elements)
inspect_3 = InspectElement(Element=split.ListB)
inspect_4 = InspectElement(Element=split.ListA)  # -> ConstraintsUnconnectedHeight, DimensionsLength
data = Data(inspect_2)
data_2 = Data(inspect)
data_3 = Data(inspect_4.ConstraintsUnconnectedHeight)
H = Data([data_3, data_2, data])
ma = MassAddition(Input=flatten(H))  # -> Result, PartialResults
H_2 = Number(expr("x*0.001", ma.Result))
W = Number(expr("x*0.001", inspect_3))
L = Number(expr("x*0.001", inspect_4.DimensionsLength))
entwine = Entwine(Branch00=L, Branch01=W, Branch02=H_2, FlattenInputs=True)

# ---- group: Walls
levels_4 = LevelsPicker([<levels picker referenced from the Revit model> x3])
categories_2 = BuiltInCategories("autodesk.revit.category.local:walls-1.0.0", SearchPattern="Walls")
element_type_picker_2 = ElementTypePicker(
    categories_2,
    {"Basic Wall : Exterior - Block on Mtl. Stud": "f2c11db4-bcd8-4ff1-9607-80f944683cd0:f8dc8733-6ca1-4a9e-bd25-3e0787704d28-000126b7", "Basic Wall : Exterior - CMU on Brick 370mm 1": "f2c11db4-bcd8-4ff1-9607-80f944683cd0:f7a44ea8-20d4-4b4c-bee2-4a9d515d56a0-000330f4", "Curtain Wall : Curtain Wall": "f2c11db4-bcd8-4ff1-9607-80f944683cd0:cb74be9d-0c49-4127-96a8-1de4e3dd00ba-00005979", "Curtain Wall : Exterior Glazing": "f2c11db4-bcd8-4ff1-9607-80f944683cd0:22712c68-ecc0-4fdf-bdbb-929626510e37-0000c6f7", "Curtain Wall : Storefront": "f2c11db4-bcd8-4ff1-9607-80f944683cd0:22712c68-ecc0-4fdf-bdbb-929626510e37-0000c6f8"}, selected="Basic Wall : Exterior - CMU on Brick 370mm 1")
levelfltr_4 = LevelFilter(Levels=levels_4, Inverted=False)

# ----
categories_3 = BuiltInCategories("autodesk.revit.category.local:roofs-1.0.0", SearchPattern="Roofs")
types = QueryTypes(Kind=3, Category=categories_3)
types_2 = QueryTypes(Kind=3, Category=categories)
list = ItemSelector(
    types_2,
    {"Revit Host Type : Basic Wall : Exterior - CMU on Brick 370mm : id 251", "Revit Host Type : Basic Wall : Generic - 150mm Precast : id 254", "Revit Host Type : Curtain Wall : Curtain Wall : id 22905", "Revit Host Type : Basic Wall : Foundation - 300mm Concrete : id 31000", "Revit Host Type : Curtain Wall : Exterior Glazing : id 50935", "Revit Host Type : Curtain Wall : Storefront : id 50936", "Revit Host Type : Basic Wall : Exterior - CMU on Mtl Stud : id 214947", "Revit Host Type : Basic Wall : Interior - 152mm Partition (1-hr) Custom : id 269185", "Revit Host Type : Basic Wall : Generic - 200mm Precast 2 : id 352105"}, selected="Revit Host Type : Curtain Wall : Exterior Glazing : id 50935")
list_2 = ItemSelector(
    types,
    {"Revit Host Type : Basic Roof : Generic Roof - 315mm : id 223", "Revit Host Type : Sloped Glazing : Sloped Glazing : id 19114"}, selected="Revit Host Type : Sloped Glazing : Sloped Glazing : id 19114")
inspect_5 = InspectElement(Element=list_2)
inspect_6 = InspectElement(Element=list)
num = Number(inspect_5)
num_2 = Number(inspect_6)
entwine_2 = Entwine(Branch00=num_2, Branch01=num, FlattenInputs=True)

categories_4 = BuiltInCategories("autodesk.revit.category.local:roofs-1.0.0", SearchPattern="Roofs")
element_type_picker_3 = ElementTypePicker(
    categories_4,
    {"Basic Roof : Generic Roof - 315mm": "f2c11db4-bcd8-4ff1-9607-80f944683cd0:f7a44ea8-20d4-4b4c-bee2-4a9d515d56a0-000330f2", "Sloped Glazing : Sloped Glazing": "f2c11db4-bcd8-4ff1-9607-80f944683cd0:cb74be9d-0c49-4127-96a8-1de4e3dd00ba-00004aaa"}, selected="Basic Roof : Generic Roof - 315mm")
typefltr_2 = TypeFilter(Types=element_type_picker_3, Inverted=False)
elements_4 = QueryElements(Filter=typefltr_2, Limit="1")  # -> Elements, Count
roof = Roof(elements_4.Elements)

rooms = QueryRooms(Placed=True)
room = Room(rooms)
boundary_location = BoundaryLocation({"Finish": 0, "Center": 1, "CoreBoundary": 2, "CoreCenter": 3}, selected="Finish")
se_geometry = SpatialElementGeometry(SpatialElement=room, BoundaryLocation=boundary_location)  # -> Geometry, TopFaces, SideFaces, BottomFaces
identity = SpatialElementIdentity(SpatialElement=room)
geo = Geometry(se_geometry.Geometry)

# ---- group: Walls / Exterior Walls
typefltr_3 = TypeFilter(Types=element_type_picker_2, Inverted=False)
andfltr_4 = LogicalAndFilter(FilterA=typefltr_3, FilterB=levelfltr_4)
elements_5 = QueryElements(Filter=andfltr_4, Limit=100)  # -> Elements, Count
elements_6 = QueryElements(Filter=andfltr_4, Limit="1")  # -> Elements, Count
faces = HostFaces(Host=elements_5.Elements)  # -> Top, Bottom, Exterior, Interior
wall = Wall(elements_6.Elements)

# ----
inspect_7 = InspectElement(Element=roof)
u_value = GhPythonScript(sR=inspect_7)  # -> sD
# ---------- u_value: Python ----------
__author__ = "daovi"
__version__ = "2023.10.29"

import rhinoscriptsyntax as rs
import clr
clr.AddReference('System.Core')
clr.AddReference('RhinoInside.Revit')
clr.AddReference('RevitAPI') 
clr.AddReference('RevitAPIUI')

from System import Enum

import rhinoscriptsyntax as rs
import Rhino
import RhinoInside
import Grasshopper
from RhinoInside.Revit import Revit, Convert
from Autodesk.Revit import DB


doc = Revit.ActiveDBDocument

sD = DB.UnitUtils.Convert(sR, DB.UnitTypeId.Radians, DB.UnitTypeId.Degrees)
# ---------- end u_value ----------
num_3 = Number(0.001)

e_type = ElementType(Element=roof)  # -> Element, Type
compstruct = HostTypeCompoundStructure(Type=e_type.Type)  # -> Type, Structure
dstruct = DeconstructCompoundStructure(Structure=compstruct.Structure)  # -> ExteriorLayers, CoreLayers, InteriorLayers
dstructlayer = DeconstructCompoundStructureLayer(Layer=dstruct.ExteriorLayers)  # -> Function, Material, Thickness, Wraps
dstructlayer_2 = DeconstructCompoundStructureLayer(Layer=dstruct.CoreLayers)  # -> Function, Material, Thickness, Wraps
dstructlayer_3 = DeconstructCompoundStructureLayer(Layer=dstruct.InteriorLayers)  # -> Function, Material, Thickness, Wraps
material = Material(dstructlayer.Material)
material_2 = Material(dstructlayer_3.Material)
material_3 = Material(dstructlayer_2.Material)
merge = Merge(Data1=dstructlayer.Thickness, Data2=dstructlayer_2.Thickness, Data3=dstructlayer_3.Thickness)
merge_2 = Merge(Data1=material, Data2=material_3, Data3=material_2)
panel = Panel("0.001")
extract_material_s_assets = ExtractMaterialsAssets(Material=merge_2)  # -> AppearanceAsset, PhysicalAsset, ThermalAsset
identity_2 = MaterialIdentity(Material=merge_2)  # -> flatten(Name)
multiplication = Multiplication(A=merge, B=num_3)  # -> flatten(Result)
u_value_2 = GhPythonScript(TA=extract_material_s_assets.ThermalAsset)  # -> TC, D, SH
# ---------- u_value_2: Python ----------
__author__ = "daovi"
__version__ = "2023.10.29"

import rhinoscriptsyntax as rs
import clr
clr.AddReference('System.Core')
clr.AddReference('RhinoInside.Revit')
clr.AddReference('RevitAPI') 
clr.AddReference('RevitAPIUI')

from System import Enum

import rhinoscriptsyntax as rs
import Rhino
import RhinoInside
import Grasshopper
from RhinoInside.Revit import Revit, Convert
from Autodesk.Revit import DB


doc = Revit.ActiveDBDocument


if isinstance(TA, DB.PropertySetElement):
    asset = TA.GetThermalAsset()
    TC = asset.ThermalConductivity
    TC = DB.UnitUtils.ConvertFromInternalUnits(TC,DB.UnitTypeId.WattsPerMeterKelvin)
    D = asset.Density
    D = DB.UnitUtils.ConvertFromInternalUnits(D,DB.UnitTypeId.KilogramsPerCubicMeter)
    SH = asset.SpecificHeat
    SH = DB.UnitUtils.ConvertFromInternalUnits(SH,DB.UnitTypeId.JoulesPerKilogramDegreeCelsius)
    print(TC, D, SH)
# ---------- end u_value_2 ----------

num_4 = Number(0.001)

e_type_2 = ElementType(Element=wall)  # -> Element, Type
a_bwt = AnalyzeBasicWallType(BasicWallType=e_type_2.Element)  # -> Structure, WrappingAtInserts, WrappingAtEnds, Width, Function
dstruct_2 = DeconstructCompoundStructure(Structure=a_bwt.Structure)  # -> ExteriorLayers, CoreLayers, InteriorLayers
dstructlayer_4 = DeconstructCompoundStructureLayer(Layer=dstruct_2.ExteriorLayers)  # -> Function, Material, Thickness, Wraps
dstructlayer_5 = DeconstructCompoundStructureLayer(Layer=dstruct_2.InteriorLayers)  # -> Function, Material, Thickness, Wraps
dstructlayer_6 = DeconstructCompoundStructureLayer(Layer=dstruct_2.CoreLayers)  # -> Function, Material, Thickness, Wraps
material_4 = Material(dstructlayer_5.Material)
material_5 = Material(dstructlayer_6.Material)
material_6 = Material(dstructlayer_4.Material)
merge_3 = Merge(Data1=dstructlayer_4.Thickness, Data2=dstructlayer_6.Thickness, Data3=dstructlayer_5.Thickness)
merge_4 = Merge(Data1=material_6, Data2=material_5, Data3=material_4)
extract_material_s_assets_2 = ExtractMaterialsAssets(Material=merge_4)  # -> AppearanceAsset, PhysicalAsset, ThermalAsset
identity_3 = MaterialIdentity(Material=merge_4)  # -> flatten(Name)
multiplication_2 = Multiplication(A=merge_3, B=num_4)  # -> flatten(Result)
u_value_3 = GhPythonScript(TA=extract_material_s_assets_2.ThermalAsset)  # -> TC, D, SH; same code as u_value_2

genes = GenePool(Decimals=3, Maximum=1.25, Minimum=0.75, Value=[1.02, 1.25, 1.25, 1.05])
genes_2 = GenePool(Decimals=3, Maximum=1.25, Minimum=0.75, Value=[0.98, 0.75, 0.75, 0.95])

panel_3 = Panel(identity_2)

list_3 = ItemSelector(genes_2, {"0.98", "0.75", "0.75", "0.95"}, selected="0.75")
list_4 = ItemSelector(genes, {"1.02", "1.25", "1.25", "1.05"}, selected="1.25")
multiplication_3 = Multiplication(A=flatten(entwine_2), B=list_4)
multiplication_4 = Multiplication(A=flatten(entwine_2), B=list_3)
num_5 = Number(expr("Round(x,4)", multiplication_3))
num_6 = Number(expr("Round(x,4)", multiplication_4))
panel_4 = Panel("""T_ExWa
T_ExRf""")
expression = Expression(
    name=panel_4,
    lower_bound=num_6,
    upper_bound=num_5,
    group="Group_2",
    Expression="Format(\"{0} {1} {2} {3}\", name, lower_bound, upper_bound, group)")
panel_5 = Panel(expression)

list_5 = ItemSelector(genes_2, {"0.98", "0.75", "0.75", "0.95"}, selected="0.98")
list_6 = ItemSelector(genes, {"1.02", "1.25", "1.25", "1.05"}, selected="1.02")
multiplication_5 = Multiplication(A=flatten(entwine), B=list_5)
multiplication_6 = Multiplication(A=flatten(entwine), B=list_6)
num_7 = Number(expr("Round(x,4)", multiplication_6))
num_8 = Number(expr("Round(x,4)", multiplication_5))
panel_6 = Panel("""L
W
H""")
expression_2 = Expression(
    name=panel_6,
    lower_bound=num_8,
    upper_bound=num_7,
    group="Group_1",
    Expression="Format(\"{0} {1} {2} {3}\", name, lower_bound, upper_bound, group)")
panel_7 = Panel(expression_2)

panel_8 = Panel("1")

bldgvintages = HBBuildingVintages({"ASHRAE 90.1 2019  |  IECC 2021": "2019", "ASHRAE 90.1 2016  |  IECC 2018": "2016", "ASHRAE 90.1 2013  |  IECC 2015": "2013", "ASHRAE 90.1 2010  |  IECC 2012": "2010", "ASHRAE 90.1 2007  |  IECC 2009": "2007", "ASHRAE 90.1 2004  |  IECC 2006": "2004", "1980-2004 (CBECS)": "1980_2004", "Pre-1980 (CBECS)": "pre_1980"}, selected="ASHRAE 90.1 2019  |  IECC 2021")
constructiontypes = HBConstructionTypes({"SteelFramed", "WoodFramed", "Mass", "Metal Building"}, selected="SteelFramed")
climatezones = HBClimateZones({"1 - Very Hot": "1", "2 - Hot": "2", "3 - Warm": "3", "4 - Mixed": "4", "5 - Cool": "5", "6 - Cold": "6", "7 - Very Cold": "7", "8 - Subarctic": "8"}, selected="5 - Cool")
constrsetclimate = HBConstructionSetByClimate(climate_zone=climatezones, vintage=bldgvintages, constr_type=constructiontypes)  # -> constr_set; plug-in component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

panel_9 = Panel("https://climate.onebuilding.org/WMO_Region_6_Europe/DEU_Germany/BY_Bayern/DEU_BY_Munich.AP.108700_TMYx.zip")
downloadepw = LBDownloadWeather(weather_URL=panel_9)  # -> epw_file, stat_file, ddy_file; plug-in component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

toggle = BooleanToggle(False)
fly = Ladybug_fly()  # -> Vviiiiiiiiiizzz; plug-in component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
fly_2 = Ladybug_fly()  # -> Vviiiiiiiiiizzz; plug-in component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
fly_3 = Ladybug_fly()  # -> Vviiiiiiiiiizzz; plug-in component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

path = FilePath("C:\Users\daovi\Documents\Jiabin_BDL3_1200-withresults\Jiabin_BDL3_1200\model_input.txt")
number_slider = Slider(0, range=0..1199)
file = ReadFile(File=path, PerLineParse=True)
cset = CreateSet(List=file)  # -> Set, Map
item = ListItem(List=cset.Set, Index=number_slider, Wrap=True)
split_2 = TextSplit(Text=item, Separators="\" \"")
item_2 = ListItem(List=split_2, Index=0, Wrap=True)  # -> Item, Item1, Item2, Item3, Item4, Item5, Item6, Item7, Item8
merge_5 = Merge(Data1=item_2.Item7, Data2=item_2.Item8)
merge_6 = Merge(Data1=item_2.Item5, Data2=item_2.Item6)
merge_7 = Merge(Data1=item_2.Item3, Data2=item_2.Item4)
merge_8 = Merge(Data1=item_2.Item, Data2=item_2.Item1, Data3=item_2.Item2)
division = Division(A=flatten(merge_7), B=flatten(entwine_2))
division_2 = Division(A=flatten(merge_8), B=flatten(entwine))
bang = ExplodeTree(Data=graft(division))  # -> Branch0, Branch1
bang_2 = ExplodeTree(Data=graft(division_2))  # -> Branch0, Branch1, Branch2

brute = BruteForceClassic(Run=Toggle(False), NumberSliders=number_slider)

scale_nu = ScaleNU(Geometry=geo, Plane=PlaneXY(0, 0, 0), ScaleX=bang_2.Branch0, ScaleY=bang_2.Branch1, ScaleZ=bang_2.Branch2)  # -> Geometry, Transform
geo_2 = Geometry(scale_nu.Geometry)

multiplication_7 = Multiplication(A=multiplication, B=bang.Branch1)
multiplication_8 = Multiplication(A=multiplication_2, B=bang.Branch0)

opaquemat = HBOpaqueMaterial(thickness=multiplication_8, conductivity=u_value_3.TC, density=u_value_3.D, spec_heat=u_value_3.SH)  # -> mat; plug-in component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
opaquemat_2 = HBOpaqueMaterial(thickness=multiplication_7, conductivity=u_value_2.TC, density=u_value_2.D, spec_heat=u_value_2.SH)  # -> mat; plug-in component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
opaqueconstr = HBOpaqueConstruction(name="Roof", materials=opaquemat_2)  # -> constr; plug-in component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
opaqueconstr_2 = HBOpaqueConstruction(name="Exterior Wall", materials=opaquemat)  # -> constr; plug-in component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

exteriorsubset = HBExteriorConstructionSubset(exterior_wall=opaqueconstr_2, exterior_roof=opaqueconstr)  # -> exterior_set; plug-in component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
constructionset = HBConstructionSet(name="ConstructionSet with Revit material", base_constr_set=constrsetclimate, exterior_subset=exteriorsubset)  # -> constr_set; plug-in component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

list_7 = ItemSelector(genes_2, {"0.98", "0.75", "0.75", "0.95"}, selected="0.75")
list_8 = ItemSelector(genes, {"1.02", "1.25", "1.25", "1.05"}, selected="1.25")
panel_10 = Panel("""WWR
Infil""")

list_9 = ItemSelector(genes_2, {"0.98", "0.75", "0.75", "0.95"}, selected="0.95")
list_10 = ItemSelector(genes, {"1.02", "1.25", "1.25", "1.05"}, selected="1.05")
panel_11 = Panel("""C_COP
H_COP""")

# ---- group: Parameter file
panel_12 = Panel("C:\Users\daovi\Documents\data\Sobol\BDL3\parameter_file.txt")

# ----
toggle_2 = BooleanToggle(True)
intsolid = HBIntersectSolids(rooms=flatten(geo_2), run=toggle_2)  # -> int_rooms; plug-in component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

bldgvintages_2 = HBBuildingVintages({"ASHRAE 90.1 2019  |  IECC 2021": "2019", "ASHRAE 90.1 2016  |  IECC 2018": "2016", "ASHRAE 90.1 2013  |  IECC 2015": "2013", "ASHRAE 90.1 2010  |  IECC 2012": "2010", "ASHRAE 90.1 2007  |  IECC 2009": "2007", "ASHRAE 90.1 2004  |  IECC 2006": "2004", "1980-2004 (CBECS)": "1980_2004", "Pre-1980 (CBECS)": "pre_1980"}, selected="ASHRAE 90.1 2019  |  IECC 2021")
bldgprograms = HBBuildingPrograms({"LargeOffice", "MediumOffice", "SmallOffice", "MidriseApartment", "HighriseApartment", "Retail", "StripMall", "PrimarySchool", "SecondarySchool", "SmallHotel", "LargeHotel", "Hospital", "Outpatient", "Laboratory", "Warehouse", "SuperMarket", "FullServiceRestaurant", "QuickServiceRestaurant", "Courthouse", "College", "LargeDataCenterHighITE", "LargeDataCenterLowITE", "SmallDataCenterHighITE", "SmallDataCenterLowITE"}, selected="MediumOffice")
searchprog = HBSearchPrograms(bldg_prog=bldgprograms, vintage=bldgvintages_2, keywords=graft(identity))  # -> room_prog; plug-in component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

dom = ConstructDomain(DomainStart="11", DomainEnd="40")
dom_2 = ConstructDomain(DomainStart="0", DomainEnd="9")

num_9 = Number(0.002)
num_10 = Number(0.33)

entwine_3 = Entwine(Branch00=num_10, Branch01=num_9, FlattenInputs=True)

multiplication_9 = Multiplication(A=flatten(entwine_3), B=list_7)
multiplication_10 = Multiplication(A=flatten(entwine_3), B=list_8)
num_11 = Number(expr("Round(x,4)", multiplication_10))
num_12 = Number(expr("Round(x,4)", multiplication_9))
expression_3 = Expression(
    name=panel_10,
    lower_bound=num_12,
    upper_bound=num_11,
    group="Group_3",
    Expression="Format(\"{0} {1} {2} {3}\", name, lower_bound, upper_bound, group)")
panel_13 = Panel(expression_3)

division_3 = Division(A=flatten(merge_6), B=flatten(entwine_3))
bang_3 = ExplodeTree(Data=graft(division_3))  # -> Branch0, Branch1

multiplication_11 = Multiplication(A=num_10, B=bang_3.Branch0)
multiplication_12 = Multiplication(A=num_9, B=bang_3.Branch1)

applyloadvals = HBApplyLoadValues(room_or_program=flatten(searchprog), infilt_per_exterior=multiplication_12)  # -> report, mod_obj; plug-in component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

roomsolid = HBRoomFromSolid(geo=flatten(intsolid), name=identity, constr_set=constructionset, program=applyloadvals.mod_obj, conditioned=True)  # -> report, rooms; plug-in component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

item_3 = ListItem(List=roomsolid.rooms, Index="10", Wrap=True)
subset = SubList(List=roomsolid.rooms, Domain=[dom_2, dom], Wrap=True)  # -> List, Index

skylightsbyratio = HBSkylightsByRatio(hb_objs=flatten(item_3), ratio=Slider(0.5, range=0..1))  # -> report, hb_objs; plug-in component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

solveadj = HBSolveAdjacency(rooms=flatten([subset.List, skylightsbyratio.hb_objs]), run=toggle_2)  # -> report, adj_rooms; plug-in component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
aperturesbyratio = HBAperturesByRatio(hb_objs=flatten(solveadj.adj_rooms), ratio=multiplication_11)  # -> report, hb_objs; plug-in component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
bordershades = HBExtrudedBorderShades(hb_objs=flatten(aperturesbyratio.hb_objs), depth="500")  # -> report, flatten(hb_objs); plug-in component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

num_13 = Number(0.85)
num_14 = Number(4)

entwine_4 = Entwine(Branch00=num_14, Branch01=num_13, FlattenInputs=True)

division_4 = Division(A=flatten(merge_5), B=flatten(entwine_4))
bang_4 = ExplodeTree(Data=graft(division_4))  # -> Branch0, Branch1

multiplication_13 = Multiplication(A=flatten(entwine_4), B=list_9)
multiplication_14 = Multiplication(A=flatten(entwine_4), B=list_10)
num_15 = Number(expr("Round(x,4)", multiplication_14))
num_16 = Number(expr("Round(x,4)", multiplication_13))
expression_4 = Expression(
    name=panel_11,
    lower_bound=num_16,
    upper_bound=num_15,
    group="Group_4",
    Expression="Format(\"{0} {1} {2} {3}\", name, lower_bound, upper_bound, group)")
panel_14 = Panel(expression_4)

# ---- group: Parameter file (continued)
merge_9 = Merge(Data1="#name lower_bound upper_bound group", Data2=panel_7, Data3=panel_5, Data4=panel_13, Data5=panel_14)
panel_15 = Panel(merge_9)
writetxt = WriteToTextFile(Run=Toggle(False), TextToWrite=panel_15, FilePath=panel_12, Append=False, NewOnly=False)

# ----
multiplication_15 = Multiplication(A=num_14, B=bang_4.Branch0)
multiplication_16 = Multiplication(A=num_13, B=bang_4.Branch1)

annualloads = HBAnnualLoads(
    rooms=flatten(bordershades.hb_objs),
    epw_file=downloadepw.epw_file,
    cool_cop=multiplication_15,
    heat_cop=multiplication_16,
    run_bal=toggle,
    run=toggle)  # -> report, total_load, cooling, heating, lighting, equip, process, hot_water, balance; plug-in component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
data_4 = Data(flatten([annualloads.cooling, annualloads.heating, annualloads.lighting, annualloads.equip]))

item_4 = ListItem(List=annualloads.total_load, Index=0, Wrap=True)  # -> Item, Item1, Item2, Item3
ma_2 = MassAddition(Input=annualloads.total_load)  # -> Result, PartialResults
expression_5 = Expression(
    total_load=ma_2.Result,
    cooling=item_4.Item,
    heating=item_4.Item1,
    lighting=item_4.Item2,
    equip=item_4.Item3,
    Expression="Format(\"{0} {1} {2} {3} {4}\", total_load, cooling, heating, lighting, equip)")
rec = DataRecorder(flatten(expression_5), DataLimit=-10, RecordData=True)
merge_10 = Merge(Data1="#total_load cooling heating lighting equip", Data2=rec)  # -> flatten(Result)
writetxt_2 = WriteToTextFile(
    Run=Toggle(False),
    TextToWrite=merge_10,
    FilePath="C:\Users\daovi\Documents\data\Morris\BDL3\model_output.txt",
    Append=False,
    NewOnly=False)

number_slider_2 = Slider(65, range=0..100)
colrange = LBColorRange(index="19")  # -> colors; plug-in component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
panel_16 = Panel("21")
panel_17 = Panel("11")
neg = Negative(Value=number_slider_2)
legendpar = LBLegendParameters(min=neg, max=number_slider_2, colors=colrange)  # -> leg_par; plug-in component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
legendpar_2 = LBLegendParameters(
    max=number_slider_2,
    colors=[ColourSwatch(SwatchColor=RGB(0, 0, 255)), ColourSwatch(SwatchColor=RGB(207, 0, 0)), ColourSwatch(SwatchColor=RGB(250, 255, 97)), ColourSwatch(SwatchColor=RGB(255, 116, 74))])  # -> leg_par; plug-in component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
pt = Point(Point(26794.68925, 18356.48148, 0))
monthlychart = LBMonthlyChart(data=data_4, base_pt=pt, stack=Toggle(True), legend_par=legendpar_2)  # -> report, data_mesh, data_lines, col_lines, legend, borders, labels, y_title, title, vis_set; plug-in component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
monthlychart_2 = LBMonthlyChart(data=annualloads.balance, base_pt=pt, stack=Toggle(True), legend_par=legendpar)  # -> report, data_mesh, data_lines, col_lines, legend, borders, labels, y_title, title, vis_set; plug-in component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
geo_3 = Geometry([monthlychart_2.data_mesh, monthlychart_2.data_lines, monthlychart_2.col_lines, monthlychart_2.legend, monthlychart_2.borders, monthlychart_2.labels, monthlychart_2.y_title, monthlychart_2.title])

panel_18 = Panel(expression_5)
