# Grasshopper definition BDL4_x.gh (Grasshopper 1.0.7)
# plug-ins: Rhino.Inside for Autodesk Revit, Bifocals, Human, CORE.Toolbox.Grasshopper, Wombat

categories = BuiltInCategories("autodesk.revit.category.local:roofs-1.0.0", SearchPattern="Roofs")
element_type_picker = ElementTypePicker(
    categories,
    {"Basic Roof : Generic Roof - 315mm": "ae10bcee-6025-4be2-afa1-8c03e1484f54:933c4a06-93b8-11d3-80f8-00c04f8efc32-000000df", "Sloped Glazing : Sloped Glazing": "ae10bcee-6025-4be2-afa1-8c03e1484f54:cb74be9d-0c49-4127-96a8-1de4e3dd00ba-00004aaa"}, selected="Basic Roof : Generic Roof - 315mm")
typefltr = TypeFilter(Types=element_type_picker, Inverted=False)
elements = QueryElements(Filter=typefltr, Limit="1")  # -> Elements, Count
roof = Roof(elements.Elements)
inspect = InspectElement(Element=roof)
python = GhPythonScript(sR=inspect)  # -> sD
# ---------- python: Python ----------
__author__ = "daovi"
__version__ = "2023.11.08"

import rhinoscriptsyntax as rs
import clr
clr.AddReference('System.Core')
clr.AddReference('RhinoInside.Revit')
clr.AddReference('RevitAPI') 
clr.AddReference('RevitAPIUI')

from System import Enum

import rhinoscriptsyntax as rs
import Rhino
import RhinoInside
import Grasshopper
from RhinoInside.Revit import Revit, Convert
from Autodesk.Revit import DB


doc = Revit.ActiveDBDocument

sD = DB.UnitUtils.Convert(sR, DB.UnitTypeId.Radians, DB.UnitTypeId.Degrees)
print(sD)
# ---------- end python ----------

categories_2 = BuiltInCategories("autodesk.revit.category.local:floors-1.0.0", SearchPattern="Floors")
element_type_picker_2 = ElementTypePicker(
    categories_2,
    {"Floor : 160mm Concrete With 50mm Metal Deck": "ae10bcee-6025-4be2-afa1-8c03e1484f54:8e7d7553-91a0-4bc8-9ebe-1142f6a05adb-00021b5a", "Floor : Generic Floor - 200mm - Precast": "ae10bcee-6025-4be2-afa1-8c03e1484f54:14df6a26-ac69-4a3e-b0e0-3aceb6078044-00009d9e", "Floor : Generic Floor - Precast Concrete 215mm": "ae10bcee-6025-4be2-afa1-8c03e1484f54:933c4a06-93b8-11d3-80f8-00c04f8efc32-000000e2", "Floor : Wood Joist 220mm - Wood Finish": "ae10bcee-6025-4be2-afa1-8c03e1484f54:7e6bd360-e7e3-11d4-92dd-0000863f27ad-0000632e"}, selected="Floor : Generic Floor - Precast Concrete 215mm")
typefltr_2 = TypeFilter(Types=element_type_picker_2, Inverted=False)
elements_2 = QueryElements(Filter=typefltr_2, Limit="1")  # -> Elements, Count
floor = Floor(elements_2.Elements)

categories_3 = BuiltInCategories("autodesk.revit.category.local:ceilings-1.0.0", SearchPattern="Ceilings")
element_type_picker_3 = ElementTypePicker(
    categories_3,
    {"Basic Ceiling : Generic": "ae10bcee-6025-4be2-afa1-8c03e1484f54:933c4a06-93b8-11d3-80f8-00c04f8efc32-000000e3", "Compound Ceiling : 600 x 1200mm grid": "ae10bcee-6025-4be2-afa1-8c03e1484f54:cb74be9d-0c49-4127-96a8-1de4e3dd00ba-0000a122", "Compound Ceiling : 600 x 600mm grid": "ae10bcee-6025-4be2-afa1-8c03e1484f54:79879255-deed-465d-b94e-38a95196a30f-0000a123", "Compound Ceiling : GWB on Mtl. Stud": "ae10bcee-6025-4be2-afa1-8c03e1484f54:e3fc26cf-68b3-4ecd-a9b2-ea2651289064-000348e2"}, selected="Compound Ceiling : 600 x 1200mm grid")
typefltr_3 = TypeFilter(Types=element_type_picker_3, Inverted=False)
elements_3 = QueryElements(Filter=typefltr_3, Limit="1")  # -> Elements, Count
ceiling = Ceiling(elements_3.Elements)

categories_4 = BuiltInCategories("autodesk.revit.category.local:roofs-1.0.0", SearchPattern="roofs")

categories_5 = BuiltInCategories("autodesk.revit.category.local:walls-1.0.0", SearchPattern="Walls")
levels = LevelsPicker(<levels picker referenced from the Revit model>)
levels_2 = LevelsPicker(<levels picker referenced from the Revit model>)
levels_3 = LevelsPicker(<levels picker referenced from the Revit model>)
element_type_picker_4 = ElementTypePicker(
    categories_5,
    {"Basic Wall : Exterior - CMU on Brick 370mm": "ae10bcee-6025-4be2-afa1-8c03e1484f54:933c54e0-93b8-11d3-80f8-00c04f8efc32-000000fb", "Basic Wall : Exterior - CMU on Mtl Stud": "ae10bcee-6025-4be2-afa1-8c03e1484f54:e3fc26cf-68b3-4ecd-a9b2-ea2651289064-000347a3", "Basic Wall : Foundation - 300mm Concrete": "ae10bcee-6025-4be2-afa1-8c03e1484f54:512df941-5e7a-4a19-978a-195f60dd4943-00007918", "Basic Wall : Generic - 150mm Precast": "ae10bcee-6025-4be2-afa1-8c03e1484f54:933c54e1-93b8-11d3-80f8-00c04f8efc32-000000fe", "Basic Wall : Generic - 200mm Precast 2": "ae10bcee-6025-4be2-afa1-8c03e1484f54:f9686a97-fbf0-47d5-8824-2e027b02ec94-00055f69", "Basic Wall : Interior - 152mm Partition (1-hr) Custom": "ae10bcee-6025-4be2-afa1-8c03e1484f54:d2f64782-8b17-492f-90b8-9576898a42df-00041b81", "Curtain Wall : Curtain Wall": "ae10bcee-6025-4be2-afa1-8c03e1484f54:cb74be9d-0c49-4127-96a8-1de4e3dd00ba-00005979", "Curtain Wall : Exterior Glazing": "ae10bcee-6025-4be2-afa1-8c03e1484f54:22712c68-ecc0-4fdf-bdbb-929626510e37-0000c6f7", "Curtain Wall : Storefront": "ae10bcee-6025-4be2-afa1-8c03e1484f54:22712c68-ecc0-4fdf-bdbb-929626510e37-0000c6f8"}, selected="Basic Wall : Exterior - CMU on Brick 370mm")
levelfltr = LevelFilter(Levels=levels, Inverted=False)
levelfltr_2 = LevelFilter(Levels=levels_3, Inverted=False)
levelfltr_3 = LevelFilter(Levels=levels_2, Inverted=False)
typefltr_4 = TypeFilter(Types=element_type_picker_4, Inverted=False)
andfltr = LogicalAndFilter(FilterA=typefltr_4, FilterB=levelfltr_2)
andfltr_2 = LogicalAndFilter(FilterA=typefltr_4, FilterB=levelfltr)
andfltr_3 = LogicalAndFilter(FilterA=typefltr_4, FilterB=levelfltr_3)
elements_4 = QueryElements(Filter=andfltr_3, Limit="2")  # -> Elements, Count
elements_5 = QueryElements(Filter=andfltr, Limit="1")  # -> Elements, Count
elements_6 = QueryElements(Filter=andfltr_2, Limit="1")  # -> Elements, Count
split = SplitList(List=elements_4.Elements, Index="1")  # -> ListA, ListB
inspect_2 = InspectElement(Element=elements_5.Elements)
inspect_3 = InspectElement(Element=elements_6.Elements)
inspect_4 = InspectElement(Element=split.ListB)
inspect_5 = InspectElement(Element=split.ListA)  # -> ConstraintsUnconnectedHeight, DimensionsLength
data = Data(inspect_3)
data_2 = Data(inspect_2)
data_3 = Data(inspect_5.ConstraintsUnconnectedHeight)
H = Data([data_3, data_2, data])
ma = MassAddition(Input=flatten(H))  # -> Result, PartialResults
H_2 = Number(expr("x*0.001", ma.Result))
W = Number(expr("x*0.001", inspect_4))
L = Number(expr("x*0.001", inspect_5.DimensionsLength))
entwine = Entwine(Branch00=L, Branch01=W, Branch02=H_2, FlattenInputs=True)

element_type_picker_5 = ElementTypePicker(
    categories_4,
    {"Basic Roof : Generic Roof - 315mm": "ae10bcee-6025-4be2-afa1-8c03e1484f54:933c4a06-93b8-11d3-80f8-00c04f8efc32-000000df", "Sloped Glazing : Sloped Glazing": "ae10bcee-6025-4be2-afa1-8c03e1484f54:cb74be9d-0c49-4127-96a8-1de4e3dd00ba-00004aaa"}, selected="Sloped Glazing : Sloped Glazing")
element_type_picker_6 = ElementTypePicker(
    categories_4,
    {"Basic Roof : Generic Roof - 315mm": "ae10bcee-6025-4be2-afa1-8c03e1484f54:933c4a06-93b8-11d3-80f8-00c04f8efc32-000000df", "Sloped Glazing : Sloped Glazing": "ae10bcee-6025-4be2-afa1-8c03e1484f54:cb74be9d-0c49-4127-96a8-1de4e3dd00ba-00004aaa"}, selected="Basic Roof : Generic Roof - 315mm")

categories_6 = BuiltInCategories("autodesk.revit.category.local:roofs-1.0.0", SearchPattern="Roofs")
types = QueryTypes(Kind=3, Category=categories_6)
types_2 = QueryTypes(Kind=3, Category=categories_5)
list = ItemSelector(
    types_2,
    {"Revit Host Type : Basic Wall : Exterior - CMU on Brick 370mm : id 251", "Revit Host Type : Basic Wall : Generic - 150mm Precast : id 254", "Revit Host Type : Curtain Wall : Curtain Wall : id 22905", "Revit Host Type : Basic Wall : Foundation - 300mm Concrete : id 31000", "Revit Host Type : Curtain Wall : Exterior Glazing : id 50935", "Revit Host Type : Curtain Wall : Storefront : id 50936", "Revit Host Type : Basic Wall : Exterior - CMU on Mtl Stud : id 214947", "Revit Host Type : Basic Wall : Interior - 152mm Partition (1-hr) Custom : id 269185", "Revit Host Type : Basic Wall : Generic - 200mm Precast 2 : id 352105"}, selected="Revit Host Type : Basic Wall : Exterior - CMU on Brick 370mm : id 251")
list_2 = ItemSelector(
    types,
    {"Revit Host Type : Basic Roof : Generic Roof - 315mm : id 223", "Revit Host Type : Sloped Glazing : Sloped Glazing : id 19114"}, selected="Revit Host Type : Basic Roof : Generic Roof - 315mm : id 223")
inspect_6 = InspectElement(Element=list_2)
inspect_7 = InspectElement(Element=list)
num = Number(inspect_6)
num_2 = Number(inspect_7)
entwine_2 = Entwine(Branch00=num_2, Branch01=num, FlattenInputs=True)

# ---- group: Walls
levels_4 = LevelsPicker([<levels picker referenced from the Revit model> x3])
categories_7 = BuiltInCategories("autodesk.revit.category.local:walls-1.0.0", SearchPattern="Walls")
levelfltr_4 = LevelFilter(Levels=levels_4, Inverted=False)
element_type_picker_7 = ElementTypePicker(
    categories_7,
    {"Basic Wall : Exterior - CMU on Brick 370mm": "ae10bcee-6025-4be2-afa1-8c03e1484f54:933c54e0-93b8-11d3-80f8-00c04f8efc32-000000fb", "Basic Wall : Exterior - CMU on Mtl Stud": "ae10bcee-6025-4be2-afa1-8c03e1484f54:e3fc26cf-68b3-4ecd-a9b2-ea2651289064-000347a3", "Basic Wall : Foundation - 300mm Concrete": "ae10bcee-6025-4be2-afa1-8c03e1484f54:512df941-5e7a-4a19-978a-195f60dd4943-00007918", "Basic Wall : Generic - 150mm Precast": "ae10bcee-6025-4be2-afa1-8c03e1484f54:933c54e1-93b8-11d3-80f8-00c04f8efc32-000000fe", "Basic Wall : Generic - 200mm Precast 2": "ae10bcee-6025-4be2-afa1-8c03e1484f54:f9686a97-fbf0-47d5-8824-2e027b02ec94-00055f69", "Basic Wall : Interior - 152mm Partition (1-hr) Custom": "ae10bcee-6025-4be2-afa1-8c03e1484f54:d2f64782-8b17-492f-90b8-9576898a42df-00041b81", "Curtain Wall : Curtain Wall": "ae10bcee-6025-4be2-afa1-8c03e1484f54:cb74be9d-0c49-4127-96a8-1de4e3dd00ba-00005979", "Curtain Wall : Exterior Glazing": "ae10bcee-6025-4be2-afa1-8c03e1484f54:22712c68-ecc0-4fdf-bdbb-929626510e37-0000c6f7", "Curtain Wall : Storefront": "ae10bcee-6025-4be2-afa1-8c03e1484f54:22712c68-ecc0-4fdf-bdbb-929626510e37-0000c6f8"}, selected="Basic Wall : Interior - 152mm Partition (1-hr) Custom")
element_type_picker_8 = ElementTypePicker(
    categories_7,
    {"Basic Wall : Exterior - CMU on Brick 370mm": "ae10bcee-6025-4be2-afa1-8c03e1484f54:933c54e0-93b8-11d3-80f8-00c04f8efc32-000000fb", "Basic Wall : Exterior - CMU on Mtl Stud": "ae10bcee-6025-4be2-afa1-8c03e1484f54:e3fc26cf-68b3-4ecd-a9b2-ea2651289064-000347a3", "Basic Wall : Foundation - 300mm Concrete": "ae10bcee-6025-4be2-afa1-8c03e1484f54:512df941-5e7a-4a19-978a-195f60dd4943-00007918", "Basic Wall : Generic - 150mm Precast": "ae10bcee-6025-4be2-afa1-8c03e1484f54:933c54e1-93b8-11d3-80f8-00c04f8efc32-000000fe", "Basic Wall : Generic - 200mm Precast 2": "ae10bcee-6025-4be2-afa1-8c03e1484f54:f9686a97-fbf0-47d5-8824-2e027b02ec94-00055f69", "Basic Wall : Interior - 152mm Partition (1-hr) Custom": "ae10bcee-6025-4be2-afa1-8c03e1484f54:d2f64782-8b17-492f-90b8-9576898a42df-00041b81", "Curtain Wall : Curtain Wall": "ae10bcee-6025-4be2-afa1-8c03e1484f54:cb74be9d-0c49-4127-96a8-1de4e3dd00ba-00005979", "Curtain Wall : Exterior Glazing": "ae10bcee-6025-4be2-afa1-8c03e1484f54:22712c68-ecc0-4fdf-bdbb-929626510e37-0000c6f7", "Curtain Wall : Storefront": "ae10bcee-6025-4be2-afa1-8c03e1484f54:22712c68-ecc0-4fdf-bdbb-929626510e37-0000c6f8"}, selected="Basic Wall : Exterior - CMU on Brick 370mm")

# ----
typefltr_5 = TypeFilter(Types=element_type_picker_5, Inverted=False)
typefltr_6 = TypeFilter(Types=element_type_picker_6, Inverted=False)
elements_7 = QueryElements(Filter=typefltr_5, Limit=100)  # -> Elements, Count
elements_8 = QueryElements(Filter=typefltr_6, Limit=100)  # -> Elements, Count
geo = Geometry(elements_7.Elements)
geo_2 = Geometry(elements_8.Elements)

e_type = ElementType(Element=roof)  # -> Element, Type
compstruct = HostTypeCompoundStructure(Type=e_type.Type)  # -> Type, Structure
dstruct = DeconstructCompoundStructure(Structure=compstruct.Structure)  # -> ExteriorLayers, CoreLayers, InteriorLayers
dstructlayer = DeconstructCompoundStructureLayer(Layer=dstruct.ExteriorLayers)  # -> Function, Material, Thickness, Wraps
dstructlayer_2 = DeconstructCompoundStructureLayer(Layer=dstruct.CoreLayers)  # -> Function, Material, Thickness, Wraps
dstructlayer_3 = DeconstructCompoundStructureLayer(Layer=dstruct.InteriorLayers)  # -> Function, Material, Thickness, Wraps
material = Material(dstructlayer_3.Material)
material_2 = Material(dstructlayer_2.Material)
material_3 = Material(dstructlayer.Material)
merge = Merge(Data1=dstructlayer.Thickness, Data2=dstructlayer_2.Thickness, Data3=dstructlayer_3.Thickness)
merge_2 = Merge(Data1=material_3, Data2=material_2, Data3=material)
extract_material_s_assets = ExtractMaterialsAssets(Material=merge_2)  # -> AppearanceAsset, PhysicalAsset, ThermalAsset
identity = MaterialIdentity(Material=merge_2)
multiplication = Multiplication(A=merge, B="0.001")
u_value = GhPythonScript(TA=extract_material_s_assets.ThermalAsset)  # -> TC, D, SH
# ---------- u_value: Python ----------
__author__ = "daovi"
__version__ = "2023.10.29"

import rhinoscriptsyntax as rs
import clr
clr.AddReference('System.Core')
clr.AddReference('RhinoInside.Revit')
clr.AddReference('RevitAPI') 
clr.AddReference('RevitAPIUI')

from System import Enum

import rhinoscriptsyntax as rs
import Rhino
import RhinoInside
import Grasshopper
from RhinoInside.Revit import Revit, Convert
from Autodesk.Revit import DB

doc = Revit.ActiveDBDocument


if isinstance(TA, DB.PropertySetElement):
    asset = TA.GetThermalAsset()
    TC = asset.ThermalConductivity
    TC = DB.UnitUtils.ConvertFromInternalUnits(TC,DB.UnitTypeId.WattsPerMeterKelvin)
    D = asset.Density
    D = DB.UnitUtils.ConvertFromInternalUnits(D,DB.UnitTypeId.KilogramsPerCubicMeter)
    SH = asset.SpecificHeat
    SH = DB.UnitUtils.ConvertFromInternalUnits(SH,DB.UnitTypeId.JoulesPerKilogramDegreeCelsius)
    print(TC, D, SH)
# ---------- end u_value ----------

e_type_2 = ElementType(Element=floor)  # -> Element, Type
compstruct_2 = HostTypeCompoundStructure(Type=e_type_2.Type)  # -> Type, Structure
dstruct_2 = DeconstructCompoundStructure(Structure=compstruct_2.Structure)  # -> ExteriorLayers, CoreLayers, InteriorLayers
dstructlayer_4 = DeconstructCompoundStructureLayer(Layer=dstruct_2.ExteriorLayers)  # -> Function, Material, Thickness, Wraps
dstructlayer_5 = DeconstructCompoundStructureLayer(Layer=dstruct_2.CoreLayers)  # -> Function, Material, Thickness, Wraps
dstructlayer_6 = DeconstructCompoundStructureLayer(Layer=dstruct_2.InteriorLayers)  # -> Function, Material, Thickness, Wraps
material_4 = Material(dstructlayer_6.Material)
material_5 = Material(dstructlayer_5.Material)
material_6 = Material(dstructlayer_4.Material)
merge_3 = Merge(Data1=dstructlayer_4.Thickness, Data2=dstructlayer_5.Thickness, Data3=dstructlayer_6.Thickness)
merge_4 = Merge(Data1=material_6, Data2=material_5, Data3=material_4)
extract_material_s_assets_2 = ExtractMaterialsAssets(Material=merge_4)  # -> AppearanceAsset, PhysicalAsset, ThermalAsset
identity_2 = MaterialIdentity(Material=merge_4)
multiplication_2 = Multiplication(A=merge_3, B="0.001")
u_value_2 = GhPythonScript(TA=extract_material_s_assets_2.ThermalAsset)  # -> TC, D, SH; same code as u_value

e_type_3 = ElementType(Element=ceiling)  # -> Element, Type
compstruct_3 = HostTypeCompoundStructure(Type=e_type_3.Type)  # -> Type, Structure
dstruct_3 = DeconstructCompoundStructure(Structure=compstruct_3.Structure)  # -> ExteriorLayers, CoreLayers, InteriorLayers
dstructlayer_7 = DeconstructCompoundStructureLayer(Layer=dstruct_3.ExteriorLayers)  # -> Function, Material, Thickness, Wraps
dstructlayer_8 = DeconstructCompoundStructureLayer(Layer=dstruct_3.CoreLayers)  # -> Function, Material, Thickness, Wraps
dstructlayer_9 = DeconstructCompoundStructureLayer(Layer=dstruct_3.InteriorLayers)  # -> Function, Material, Thickness, Wraps
material_7 = Material(dstructlayer_9.Material)
material_8 = Material(dstructlayer_8.Material)
material_9 = Material(dstructlayer_7.Material)
merge_5 = Merge(Data1=dstructlayer_7.Thickness, Data2=dstructlayer_8.Thickness, Data3=dstructlayer_9.Thickness)
merge_6 = Merge(Data1=material_9, Data2=material_8, Data3=material_7)
extract_material_s_assets_3 = ExtractMaterialsAssets(Material=merge_6)  # -> AppearanceAsset, PhysicalAsset, ThermalAsset
identity_3 = MaterialIdentity(Material=merge_6)
multiplication_3 = Multiplication(A=merge_5, B="0.001")
u_value_3 = GhPythonScript(TA=extract_material_s_assets_3.ThermalAsset)  # -> TC, D, SH; same code as u_value

categories_8 = BuiltInCategories("autodesk.revit.category.family:windows-1.0.0", SearchPattern="Windows")
types_3 = QueryTypes(Kind=3, Category=categories_8)

# ---- group: Walls / Interior Walls
typefltr_7 = TypeFilter(Types=element_type_picker_7, Inverted=False)
andfltr_4 = LogicalAndFilter(FilterA=typefltr_7, FilterB=levelfltr_4)
elements_9 = QueryElements(Filter=andfltr_4, Limit="1")  # -> Elements, Count
elements_10 = QueryElements(Filter=andfltr_4, Limit=100)  # -> Elements, Count
faces = HostFaces(Host=elements_10.Elements)  # -> Top, Bottom, Exterior, Interior
wall = Wall(elements_9.Elements)
face = Face(faces.Interior)
geo_3 = Geometry(face)

# ----
e_type_4 = ElementType(Element=wall)  # -> Element, Type
a_bwt = AnalyzeBasicWallType(BasicWallType=e_type_4.Element)  # -> Structure, WrappingAtInserts, WrappingAtEnds, Width, Function
dstruct_4 = DeconstructCompoundStructure(Structure=a_bwt.Structure)  # -> ExteriorLayers, CoreLayers, InteriorLayers
dstructlayer_10 = DeconstructCompoundStructureLayer(Layer=dstruct_4.ExteriorLayers)  # -> Function, Material, Thickness, Wraps
dstructlayer_11 = DeconstructCompoundStructureLayer(Layer=dstruct_4.CoreLayers)  # -> Function, Material, Thickness, Wraps
dstructlayer_12 = DeconstructCompoundStructureLayer(Layer=dstruct_4.InteriorLayers)  # -> Function, Material, Thickness, Wraps
material_10 = Material(dstructlayer_12.Material)
material_11 = Material(dstructlayer_11.Material)
material_12 = Material(dstructlayer_10.Material)
merge_7 = Merge(Data1=material_12, Data2=material_11, Data3=material_10)
merge_8 = Merge(Data1=dstructlayer_10.Thickness, Data2=dstructlayer_11.Thickness, Data3=dstructlayer_12.Thickness)
extract_material_s_assets_4 = ExtractMaterialsAssets(Material=merge_7)  # -> AppearanceAsset, PhysicalAsset, ThermalAsset
identity_4 = MaterialIdentity(Material=merge_7)
multiplication_4 = Multiplication(A=merge_8, B="0.001")
u_value_4 = GhPythonScript(TA=extract_material_s_assets_4.ThermalAsset)  # -> TC, D, SH; same code as u_value

# ---- group: Walls / Exterior Walls
typefltr_8 = TypeFilter(Types=element_type_picker_8, Inverted=False)
andfltr_5 = LogicalAndFilter(FilterA=typefltr_8, FilterB=levelfltr_4)
elements_11 = QueryElements(Filter=andfltr_5, Limit=100)  # -> Elements, Count
elements_12 = QueryElements(Filter=andfltr_5, Limit="1")  # -> Elements, Count
faces_2 = HostFaces(Host=elements_11.Elements)  # -> Top, Bottom, Exterior, Interior
wall_2 = Wall(elements_12.Elements)
face_2 = Face(faces_2.Interior)
geo_4 = Geometry(face_2)

# ----
e_type_5 = ElementType(Element=wall_2)  # -> Element, Type
a_bwt_2 = AnalyzeBasicWallType(BasicWallType=e_type_5.Type)  # -> Structure, WrappingAtInserts, WrappingAtEnds, Width, Function
dstruct_5 = DeconstructCompoundStructure(Structure=a_bwt_2.Structure)  # -> ExteriorLayers, CoreLayers, InteriorLayers
dstructlayer_13 = DeconstructCompoundStructureLayer(Layer=dstruct_5.ExteriorLayers)  # -> Function, Material, Thickness, Wraps
dstructlayer_14 = DeconstructCompoundStructureLayer(Layer=dstruct_5.InteriorLayers)  # -> Function, Material, Thickness, Wraps
dstructlayer_15 = DeconstructCompoundStructureLayer(Layer=dstruct_5.CoreLayers)  # -> Function, Material, Thickness, Wraps
material_13 = Material(dstructlayer_14.Material)
material_14 = Material(dstructlayer_15.Material)
material_15 = Material(dstructlayer_13.Material)
merge_9 = Merge(Data1=dstructlayer_13.Thickness, Data2=dstructlayer_15.Thickness, Data3=dstructlayer_14.Thickness)
merge_10 = Merge(Data1=material_15, Data2=material_14, Data3=material_13)
extract_material_s_assets_5 = ExtractMaterialsAssets(Material=merge_10)  # -> AppearanceAsset, PhysicalAsset, ThermalAsset
identity_5 = MaterialIdentity(Material=merge_10)
multiplication_5 = Multiplication(A=merge_9, B="0.001")
u_value_5 = GhPythonScript(TA=extract_material_s_assets_5.ThermalAsset)  # -> TC, D, SH; same code as u_value

e_name = ElementName(Element=types_3)  # -> Element, Name
u_value_6 = GhPythonScript(T=types_3)  # -> Uv
# ---------- u_value_6: Python ----------
__author__ = "daovi"
__version__ = "2023.10.29"

import rhinoscriptsyntax as rs
import clr
clr.AddReference('System.Core')
clr.AddReference('RhinoInside.Revit')
clr.AddReference('RevitAPI') 
clr.AddReference('RevitAPIUI')

from System import Enum

import rhinoscriptsyntax as rs
import Rhino
import RhinoInside
import Grasshopper
from RhinoInside.Revit import Revit, Convert
from Autodesk.Revit import DB

doc = Revit.ActiveDBDocument


if isinstance(T, DB.FamilySymbol):
    P = T.LookupParameter('Heat Transfer Coefficient (U)')
    Uv = P.AsDouble()
    print(Uv)
# ---------- end u_value_6 ----------
inspect_8 = InspectElement(Element=types_3)  # -> AnalyticalPropertiesSolarHeatGainCoefficient, AnalyticalPropertiesVisualLightTransmittance

# ---- group: Windows
bbox = BoundingBox(Content=geo_4, Plane=geo_4)  # -> Box, Box_2
debox = DeconstructBox(Box=bbox.Box)  # -> Plane, X, Y, Z
deplane = DeconstructPlane(Plane=debox.Plane)  # -> Origin, XAxis, YAxis, ZAxis
pl = ConstructPlane(Origin=deplane.Origin, XAxis=deplane.XAxis, YAxis=deplane.YAxis)
planesrf = PlaneSurface(Plane=pl, XSize=debox.X, YSize=debox.Y)
sdiff = SolidDifference(BrepsA=planesrf, BrepsB=geo_4)  # -> flatten(Result)

# ---- group: Interior Doors
bbox_2 = BoundingBox(Content=geo_3, Plane=geo_3)  # -> Box, Box_2
debox_2 = DeconstructBox(Box=bbox_2.Box)  # -> Plane, X, Y, Z
deplane_2 = DeconstructPlane(Plane=debox_2.Plane)  # -> Origin, XAxis, YAxis, ZAxis
pl_2 = ConstructPlane(Origin=deplane_2.Origin, XAxis=deplane_2.XAxis, YAxis=deplane_2.YAxis)
planesrf_2 = PlaneSurface(Plane=pl_2, XSize=debox_2.X, YSize=debox_2.Y)
sdiff_2 = SolidDifference(BrepsA=planesrf_2, BrepsB=geo_3)  # -> flatten(Result)

# ----
aperture = HBAperture(geo=sdiff)  # -> report, apertures; plug-in component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

genes = GenePool(Decimals=2, Maximum=1.2, Minimum=0.75, Value=[1.01, 1.02, 1.2, 1.05])
genes_2 = GenePool(Decimals=2, Maximum=1.25, Minimum=0.8, Value=[0.99, 0.98, 0.8, 0.95])

debrep = DeconstructBrep(Brep=sdiff)  # -> flatten(Faces), Edges, Vertices
Z = UnitZ(Factor=1)
boundary = BoundarySurfaces(Edges=reparameterize(debrep.Faces))
edgesdir = EdgesFromDirections(Brep=boundary, Directions=Z, Reflex=True, Angle=0)  # -> Edges, Indices, Map
devec = DeconstructVector(Vector=edgesdir.Edges)  # -> XComponent, YComponent, ZComponent
smaller = SmallerThan(FirstNumber=devec.ZComponent, SecondNumber=0)  # -> SmallerThan, OrEqualTo
dispatch = Dispatch(List=edgesdir.Edges, DispatchPattern=smaller.SmallerThan)  # -> ListA, ListB
flip = FlipCurve(Curve=dispatch.ListA)  # -> Curve, Flag
merge_11 = Merge(Data1=flip.Curve, Data2=dispatch.ListB)
loft = Loft(Curves=merge_11, Options={Adjust=False, Closed=False, LoftEnds=0, LoftSimp=0, LoftType=0, Rebuild=10, Refit=0.01})
srf = Surface(reparameterize(loft))

list_3 = ItemSelector(genes_2, {"0.99", "0.98", "0.8", "0.95"}, selected="0.98")
list_4 = ItemSelector(genes, {"1.01", "1.02", "1.2", "1.05"}, selected="1.02")
multiplication_6 = Multiplication(A=flatten(entwine_2), B=list_3)
multiplication_7 = Multiplication(A=flatten(entwine_2), B=list_4)
num_3 = Number(expr("Round(x,4)", multiplication_7))
num_4 = Number(expr("Round(x,4)", multiplication_6))
panel = Panel("""T_ExWa
T_ExRf""")
expression = Expression(
    name=panel,
    lower_bound=num_4,
    upper_bound=num_3,
    group="Group_2",
    Expression="Format(\"{0} {1} {2} {3}\", name, lower_bound, upper_bound, group)")
panel_2 = Panel(expression)

list_5 = ItemSelector(genes_2, {"0.99", "0.98", "0.8", "0.95"}, selected="0.99")
list_6 = ItemSelector(genes, {"1.01", "1.02", "1.2", "1.05"}, selected="1.01")
multiplication_8 = Multiplication(A=flatten(entwine), B=list_5)
multiplication_9 = Multiplication(A=flatten(entwine), B=list_6)
num_5 = Number(expr("Round(x,4)", multiplication_9))
num_6 = Number(expr("Round(x,4)", multiplication_8))
panel_3 = Panel("""L
W
H""")
expression_2 = Expression(
    name=panel_3,
    lower_bound=num_6,
    upper_bound=num_5,
    group="Group_1",
    Expression="Format(\"{0} {1} {2} {3}\", name, lower_bound, upper_bound, group)")
panel_4 = Panel(expression_2)

bldgvintages = HBBuildingVintages({"ASHRAE 90.1 2019  |  IECC 2021": "2019", "ASHRAE 90.1 2016  |  IECC 2018": "2016", "ASHRAE 90.1 2013  |  IECC 2015": "2013", "ASHRAE 90.1 2010  |  IECC 2012": "2010", "ASHRAE 90.1 2007  |  IECC 2009": "2007", "ASHRAE 90.1 2004  |  IECC 2006": "2004", "1980-2004 (CBECS)": "1980_2004", "Pre-1980 (CBECS)": "pre_1980"}, selected="ASHRAE 90.1 2019  |  IECC 2021")
constructiontypes = HBConstructionTypes({"SteelFramed", "WoodFramed", "Mass", "Metal Building"}, selected="SteelFramed")
climatezones = HBClimateZones({"1 - Very Hot": "1", "2 - Hot": "2", "3 - Warm": "3", "4 - Mixed": "4", "5 - Cool": "5", "6 - Cold": "6", "7 - Very Cold": "7", "8 - Subarctic": "8"}, selected="5 - Cool")
constrsetclimate = HBConstructionSetByClimate(climate_zone=climatezones, vintage=bldgvintages, constr_type=constructiontypes)  # -> constr_set; plug-in component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

num_7 = Number(0.002)

categories_9 = BuiltInCategories("autodesk.revit.category.family:windows-1.0.0", SearchPattern="Windows")
element_type_picker_9 = ElementTypePicker(
    categories_9,
    {"Windows_Curtain_Wall : Metal_Aluminum-50_Thickness": "ae10bcee-6025-4be2-afa1-8c03e1484f54:a8ae118c-3a2f-4876-a60d-1e977dbfa8be-000514e0"}, selected="Windows_Curtain_Wall : Metal_Aluminum-50_Thickness")
typefltr_9 = TypeFilter(Types=element_type_picker_9, Inverted=False)
elements_13 = QueryElements(Filter=typefltr_9, Limit="1")  # -> Elements, Count
inspect_9 = InspectElement(Element=elements_13.Elements)  # -> DimensionsHeight, DimensionsWidth
num_8 = Number(expr("x*0.001", inspect_9.DimensionsWidth))
num_9 = Number(expr("x*0.001", inspect_9.DimensionsHeight))
multiplication_10 = Multiplication(A=num_9, B=num_8)
wi_a = Number(multiplication_10)
entwine_3 = Entwine(Branch00=wi_a, Branch01=num_7, FlattenInputs=True)

list_7 = ItemSelector(genes_2, {"0.99", "0.98", "0.8", "0.95"}, selected="0.8")
list_8 = ItemSelector(genes, {"1.01", "1.02", "1.2", "1.05"}, selected="1.2")
multiplication_11 = Multiplication(A=flatten(entwine_3), B=list_7)
multiplication_12 = Multiplication(A=flatten(entwine_3), B=list_8)
num_10 = Number(expr("Round(x,4)", multiplication_12))
num_11 = Number(expr("Round(x,4)", multiplication_11))
panel_5 = Panel("""Wi_A
Infil""")
expression_3 = Expression(
    name=panel_5,
    lower_bound=num_11,
    upper_bound=num_10,
    group="Group_3",
    Expression="Format(\"{0} {1} {2} {3}\", name, lower_bound, upper_bound, group)")
panel_6 = Panel(expression_3)

versions = HBCheckVersions()  # -> lbt_gh, python, radiance, openstudio, energyplus; plug-in component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
panel_7 = Panel(versions.lbt_gh)
panel_8 = Panel(versions.python)
panel_9 = Panel(versions.energyplus)
panel_10 = Panel(versions.openstudio)

panel_11 = Panel("https://climate.onebuilding.org/WMO_Region_6_Europe/DEU_Germany/BY_Bayern/DEU_BY_Munich.AP.108700_TMYx.zip")
downloadepw = LBDownloadWeather(weather_URL=panel_11)  # -> epw_file, stat_file, ddy_file; plug-in component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

toggle = BooleanToggle(False)

path = FilePath("C:\Users\daovi\Documents\Jiabin_BDL4_1200-withresults\Jiabin_BDL4_1200\model_input.txt")
number_slider = Slider(0, range=0..599)
file = ReadFile(File=path, PerLineParse=True)
cset = CreateSet(List=file)  # -> Set, Map
number_slider_2 = Slider(0, range=0..1)
item = ListItem(List=cset.Set, Index=number_slider, Wrap=True)
split_2 = TextSplit(Text=item, Separators="\" \"")
item_2 = ListItem(List=split_2, Index=0, Wrap=True)  # -> Item, Item1, Item2, Item3, Item4, Item5, Item6, Item7, Item8
merge_12 = Merge(Data1=item_2.Item7, Data2=item_2.Item8)
merge_13 = Merge(Data1=item_2.Item5, Data2=item_2.Item6)
merge_14 = Merge(Data1=item_2.Item3, Data2=item_2.Item4)
merge_15 = Merge(Data1=item_2.Item, Data2=item_2.Item1, Data3=item_2.Item2)
division = Division(A=flatten(merge_14), B=flatten(entwine_2))
division_2 = Division(A=flatten(merge_13), B=flatten(entwine_3))
division_3 = Division(A=flatten(merge_15), B=flatten(entwine))
bang = ExplodeTree(Data=graft(division_2))  # -> Branch0, Branch1
bang_2 = ExplodeTree(Data=graft(division))  # -> Branch0, Branch1
bang_3 = ExplodeTree(Data=graft(division_3))  # -> Branch0, Branch1, Branch2

brute = BruteForceClassic(Run=Toggle(False), NumberSliders=number_slider)

multiplication_13 = Multiplication(A=multiplication, B=bang_2.Branch1)
multiplication_14 = Multiplication(A=multiplication_5, B=bang_2.Branch0)

multiplication_15 = Multiplication(A=num_7, B=bang.Branch1)

categories_10 = BuiltInCategories("autodesk.revit.category.family:doors-1.0.0", SearchPattern="Doors")

# ---- group: Query Types
types_4 = QueryTypes(Kind=3, Category=categories_10)
list_9 = ItemSelector(
    types_4,
    {"Revit Panel Type : Doors_Dbl_Glass_1 : Glass_Dbl_Door : id 321609", "Revit Panel Type : Doors_Sgl_Glass_1 : Glass_Panel-12mm_Thickness : id 338024", "Revit Component Type : Doors_Concept_IntDbl : 1810x2110mm : id 349589", "Revit Component Type : Doors_Concept_IntSgl : 1010x2110mm : id 350630", "Revit Component Type : Doors_Concept_ExtDbl : 1810x2110mm : id 392557", "Revit Panel Type : Doors_Dbl_Glass_4 : Glass_Dbl_Door : id 393278", "Revit Component Type : Doors_Concept_ExtDbl : 1810x2110mm 2 : id 397920"}, selected="Revit Component Type : Doors_Concept_IntDbl : 1810x2110mm : id 349589")

# ----
inspect_10 = InspectElement(Element=list_9)  # -> AnalyticalPropertiesSolarHeatGainCoefficient, AnalyticalPropertiesVisualLightTransmittance
e_name_2 = ElementName(Element=list_9)  # -> Element, Name
u_value_7 = GhPythonScript(T=list_9)  # -> Uv; same code as u_value_6

opaquemat = HBOpaqueMaterial(
    name=flatten(identity_2),
    thickness=flatten(multiplication_2),
    conductivity=flatten(u_value_2.TC),
    density=flatten(u_value_2.D),
    spec_heat=flatten(u_value_2.SH))  # -> mat; plug-in component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
opaquemat_2 = HBOpaqueMaterial(
    thickness=flatten(multiplication_13),
    conductivity=flatten(u_value.TC),
    density=flatten(u_value.D),
    spec_heat=flatten(u_value.SH))  # -> mat; plug-in component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
opaquemat_3 = HBOpaqueMaterial(
    name=flatten(identity_4),
    thickness=flatten(multiplication_4),
    conductivity=flatten(u_value_4.TC),
    density=flatten(u_value_4.D),
    spec_heat=flatten(u_value_4.SH))  # -> mat; plug-in component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
opaquemat_4 = HBOpaqueMaterial(
    name=flatten(identity_3),
    thickness=flatten(multiplication_3),
    conductivity=flatten(u_value_3.TC),
    density=flatten(u_value_3.D),
    spec_heat=flatten(u_value_3.SH))  # -> mat; plug-in component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
opaquemat_5 = HBOpaqueMaterial(
    thickness=flatten(multiplication_14),
    conductivity=flatten(u_value_5.TC),
    density=flatten(u_value_5.D),
    spec_heat=flatten(u_value_5.SH))  # -> mat; plug-in component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
windowmat = HBWindowMaterial(
    u_factor=flatten(u_value_6),
    shgc=flatten(inspect_8.AnalyticalPropertiesSolarHeatGainCoefficient),
    t_vis=flatten(inspect_8.AnalyticalPropertiesVisualLightTransmittance))  # -> mat; plug-in component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
windowmat_2 = HBWindowMaterial(
    u_factor=flatten(u_value_7),
    shgc=flatten(inspect_10.AnalyticalPropertiesSolarHeatGainCoefficient),
    t_vis=flatten(inspect_10.AnalyticalPropertiesVisualLightTransmittance))  # -> mat; plug-in component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
windowconstr = HBWindowConstruction(materials=windowmat_2)  # -> constr; plug-in component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
windowconstr_2 = HBWindowConstruction(name="Exterior Window", materials=windowmat)  # -> constr; plug-in component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
opaqueconstr = HBOpaqueConstruction(name="Interior Wall", materials=opaquemat_3)  # -> constr; plug-in component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
opaqueconstr_2 = HBOpaqueConstruction(name="Ceiling", materials=opaquemat_4)  # -> constr; plug-in component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
opaqueconstr_3 = HBOpaqueConstruction(name="Roof", materials=opaquemat_2)  # -> constr; plug-in component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
opaqueconstr_4 = HBOpaqueConstruction(name="Exterior Wall", materials=opaquemat_5)  # -> constr; plug-in component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
opaqueconstr_5 = HBOpaqueConstruction(name="Floor", materials=opaquemat)  # -> constr; plug-in component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

panel_12 = Panel(opaquemat_2)
panel_13 = Panel(opaquemat_5)
panel_14 = Panel(opaquemat_4)
panel_15 = Panel(opaquemat)
panel_16 = Panel(opaquemat_3)

subfacesubset = HBSubfaceSubset(window=windowconstr_2, skylight=windowconstr_2)  # -> subface_set; plug-in component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
exteriorsubset = HBExteriorConstructionSubset(exterior_wall=opaqueconstr_4, exterior_roof=opaqueconstr_3)  # -> exterior_set; plug-in component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
interiorsubset = HBInteriorConstructionSubset(interior_wall=opaqueconstr, ceiling=opaqueconstr_2, interior_floor=opaqueconstr_5, int_glass_door=windowconstr)  # -> interior_set; plug-in component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

constructionset = HBConstructionSet(
    name="ConstructionSet with Revit material",
    base_constr_set=constrsetclimate,
    exterior_subset=exteriorsubset,
    interior_subset=interiorsubset,
    subface_subset=subfacesubset)  # -> constr_set; plug-in component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

boundary_location = BoundaryLocation({"Finish": 0, "Center": 1, "CoreBoundary": 2, "CoreCenter": 3}, selected="Finish")
rooms = QueryRooms(Placed=True)

room = Room(rooms)

se_geometry = SpatialElementGeometry(SpatialElement=room, BoundaryLocation=boundary_location)  # -> Geometry, TopFaces, SideFaces, BottomFaces
identity_6 = SpatialElementIdentity(SpatialElement=room)
geo_5 = Geometry(se_geometry.Geometry)

bldgvintages_2 = HBBuildingVintages({"ASHRAE 90.1 2019  |  IECC 2021": "2019", "ASHRAE 90.1 2016  |  IECC 2018": "2016", "ASHRAE 90.1 2013  |  IECC 2015": "2013", "ASHRAE 90.1 2010  |  IECC 2012": "2010", "ASHRAE 90.1 2007  |  IECC 2009": "2007", "ASHRAE 90.1 2004  |  IECC 2006": "2004", "1980-2004 (CBECS)": "1980_2004", "Pre-1980 (CBECS)": "pre_1980"}, selected="ASHRAE 90.1 2019  |  IECC 2021")
bldgprograms = HBBuildingPrograms({"LargeOffice", "MediumOffice", "SmallOffice", "MidriseApartment", "HighriseApartment", "Retail", "StripMall", "PrimarySchool", "SecondarySchool", "SmallHotel", "LargeHotel", "Hospital", "Outpatient", "Laboratory", "Warehouse", "SuperMarket", "FullServiceRestaurant", "QuickServiceRestaurant", "Courthouse", "College", "LargeDataCenterHighITE", "LargeDataCenterLowITE", "SmallDataCenterHighITE", "SmallDataCenterLowITE"}, selected="MediumOffice")
searchprog = HBSearchPrograms(bldg_prog=bldgprograms, vintage=bldgvintages_2, keywords=graft(identity_6))  # -> room_prog; plug-in component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
applyloadvals = HBApplyLoadValues(room_or_program=flatten(searchprog), infilt_per_exterior=multiplication_15)  # -> report, mod_obj; plug-in component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

debrep_2 = DeconstructBrep(Brep=sdiff_2)  # -> Faces, Edges, Vertices
boundary_2 = BoundarySurfaces(Edges=debrep_2.Edges)
evalsrf = EvaluateSurface(Surface=reparameterize(boundary_2), Point="0.5,0.5")  # -> Point, Normal, UDirection, VDirection, Frame

list_10 = ItemSelector(genes_2, {"0.99", "0.98", "0.8", "0.95"}, selected="0.95")
list_11 = ItemSelector(genes, {"1.01", "1.02", "1.2", "1.05"}, selected="1.05")
panel_17 = Panel("""C_COP
H_COP""")

evalsrf_2 = EvaluateSurface(Surface=srf, Point="0.5,0.0")  # -> Point, Normal, UDirection, VDirection, Frame
scale = Scale(Geometry=flatten(boundary), Center=flatten(evalsrf_2.Point), Factor=bang.Branch0)  # -> Geometry, Transform

entwine_4 = Entwine(Branch00=geo_5, Branch01=evalsrf_2.Frame, Branch02=evalsrf.Frame, FlattenInputs=True)
scale_nu = ScaleNU(Geometry=entwine_4, Plane=PlaneXY(0, 0, 0), ScaleX=bang_3.Branch0, ScaleY=bang_3.Branch1, ScaleZ=bang_3.Branch2)  # -> Geometry, Transform
bang_4 = ExplodeTree(Data=scale_nu.Geometry)  # -> Branch0, Branch1, Branch2
geo_6 = Geometry(bang_4.Branch0)

orient = Orient(Geometry=sdiff_2, Source=flatten(evalsrf.Frame), Target=bang_4.Branch2)  # -> Geometry, Transform
geo_7 = Geometry(orient.Geometry)

orient_2 = Orient(Geometry=scale.Geometry, Source=flatten(evalsrf_2.Frame), Target=bang_4.Branch1)  # -> Geometry, Transform
geo_8 = Geometry(orient_2.Geometry)

door = HBDoor(geo=flatten(geo_7), glass=Toggle(True))  # -> report, doors; plug-in component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
aperture_2 = HBAperture(geo=geo_8)  # -> report, apertures; plug-in component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
bordershades = HBExtrudedBorderShades(hb_objs=flatten(aperture_2.apertures), depth="500")  # -> report, flatten(hb_objs); plug-in component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

# ---- group: Parameter file
panel_18 = Panel("C:\Users\daovi\Documents\data\Sobol\BDL4\parameter_file.txt")

# ----
toggle_2 = BooleanToggle(True)
intsolid = HBIntersectSolids(rooms=flatten(geo_6), run=toggle_2)  # -> int_rooms; plug-in component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
roomsolid = HBRoomFromSolid(geo=flatten(intsolid), name=identity_6, constr_set=constructionset, program=applyloadvals.mod_obj, conditioned=True)  # -> report, rooms; plug-in component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

intsolid_2 = HBIntersectSolids(rooms=flatten(geo_5), run=toggle_2)  # -> int_rooms; plug-in component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
roomsolid_2 = HBRoomFromSolid(geo=flatten(intsolid_2), name=identity_6, conditioned=True)  # -> report, rooms; plug-in component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
solveadj = HBSolveAdjacency(rooms=flatten(roomsolid_2.rooms), run=toggle_2)  # -> report, adj_rooms; plug-in component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
addsubface = HBAddSubface(hb_obj=flatten(solveadj.adj_rooms), sub_faces=flatten(aperture.apertures))  # -> hb_obj; plug-in component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
geoprop = HBGeometryProperties(rooms=flatten(addsubface))  # -> ext_wall_area, ext_win_area, volume, floor_area, floor_ep_constr; plug-in component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
ma_2 = MassAddition(Input=geoprop.ext_win_area)  # -> Result, PartialResults
ma_3 = MassAddition(Input=geoprop.ext_wall_area)  # -> Result, PartialResults
panel_19 = Panel(ma_3.Result)
panel_20 = Panel(ma_2.Result)
subtraction = Subtraction(A=panel_19, B=panel_20)

dom = ConstructDomain(DomainStart="23", DomainEnd="40")
dom_2 = ConstructDomain(DomainStart="0", DomainEnd="21")
subset = SubList(List=roomsolid.rooms, Domain=[dom_2, dom], Wrap=True)  # -> List, Index
item_3 = ListItem(List=roomsolid.rooms, Index="22", Wrap=True)

skylightsbyratio = HBSkylightsByRatio(hb_objs=flatten(item_3), ratio=Slider(0.9, range=0..1))  # -> report, hb_objs; plug-in component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
bordershades_2 = HBExtrudedBorderShades(hb_objs=flatten(skylightsbyratio.hb_objs), depth="500")  # -> report, flatten(hb_objs); plug-in component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

solveadj_2 = HBSolveAdjacency(rooms=flatten([subset.List, bordershades_2.hb_objs]), run=toggle_2)  # -> report, adj_rooms; plug-in component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
addsubface_2 = HBAddSubface(hb_obj=flatten(solveadj_2.adj_rooms), sub_faces=flatten([door.doors, bordershades.hb_objs]))  # -> hb_obj; plug-in component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

vizbytype = HBVisualizeByType(hb_objs=addsubface_2)  # -> walls, interior_walls, roofs, ceilings, exterior_floors, interior_floors, air_walls, apertures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; plug-in component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
geo_9 = Geometry(vizbytype.interior_floors)
geo_10 = Geometry(vizbytype.interior_walls)
geo_11 = Geometry(vizbytype.exterior_floors)
geo_12 = Geometry(vizbytype.interior_doors)
medges = MeshEdges(Mesh=geo_10)  # -> NakedEdges, InteriorEdges, NonManifoldEdges
medges_2 = MeshEdges(Mesh=geo_11)  # -> NakedEdges, InteriorEdges, NonManifoldEdges
medges_3 = MeshEdges(Mesh=geo_9)  # -> NakedEdges, InteriorEdges, NonManifoldEdges
geo_13 = Geometry(medges.NakedEdges)
geo_14 = Geometry(medges_2.NakedEdges)
geo_15 = Geometry(medges_3.NakedEdges)

num_12 = Number(0.85)
num_13 = Number(4)

entwine_5 = Entwine(Branch00=num_13, Branch01=num_12, FlattenInputs=True)

division_4 = Division(A=flatten(merge_12), B=flatten(entwine_5))
bang_5 = ExplodeTree(Data=graft(division_4))  # -> Branch0, Branch1

multiplication_16 = Multiplication(A=flatten(entwine_5), B=list_10)
multiplication_17 = Multiplication(A=flatten(entwine_5), B=list_11)
num_14 = Number(expr("Round(x,4)", multiplication_17))
num_15 = Number(expr("Round(x,4)", multiplication_16))
expression_4 = Expression(
    name=panel_17,
    lower_bound=num_15,
    upper_bound=num_14,
    group="Group_4",
    Expression="Format(\"{0} {1} {2} {3}\", name, lower_bound, upper_bound, group)")
panel_21 = Panel(expression_4)

# ---- group: Parameter file (continued)
merge_16 = Merge(Data1="#name lower_bound upper_bound group", Data2=panel_4, Data3=panel_2, Data4=panel_6, Data6=panel_21)
panel_22 = Panel(merge_16)
writetxt = WriteToTextFile(Run=Toggle(False), TextToWrite=panel_22, FilePath=panel_18, Append=False, NewOnly=False)

# ----
multiplication_18 = Multiplication(A=num_12, B=bang_5.Branch1)
multiplication_19 = Multiplication(A=num_13, B=bang_5.Branch0)

annualloads = HBAnnualLoads(
    rooms=flatten(addsubface_2),
    epw_file=downloadepw.epw_file,
    timestep="4",
    cool_cop=multiplication_19,
    heat_cop=multiplication_18,
    run_bal=toggle,
    run=toggle)  # -> report, total_load, cooling, heating, lighting, equip, process, hot_water, balance; plug-in component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

item_4 = ListItem(List=annualloads.total_load, Index=0, Wrap=True)  # -> Item, Item1, Item2, Item3
ma_4 = MassAddition(Input=annualloads.total_load)  # -> Result, PartialResults
expression_5 = Expression(
    total_load=ma_4.Result,
    cooling=item_4.Item,
    heating=item_4.Item1,
    lighting=item_4.Item2,
    equip=item_4.Item3,
    Expression="Format(\"{0} {1} {2} {3} {4}\", total_load, cooling, heating, lighting, equip)")
rec = DataRecorder(expression_5, DataLimit=600, RecordData=True)

rec_2 = DataRecorder(item_4.Item3, DataLimit=-10, RecordData=True)
rec_3 = DataRecorder(item_4.Item1, DataLimit=-10, RecordData=True)
rec_4 = DataRecorder(ma_4.Result, DataLimit=-10, RecordData=True)
rec_5 = DataRecorder(item_4.Item2, DataLimit=-10, RecordData=True)
rec_6 = DataRecorder(item_4.Item, DataLimit=-10, RecordData=True)
panel_23 = Panel(rec_3)
panel_24 = Panel(rec)

merge_17 = Merge(Data1="#total_load cooling heating lighting equip", Data2=panel_24)
writetxt_2 = WriteToTextFile(
    Run=Toggle(False),
    TextToWrite=merge_17,
    FilePath="C:\Users\daovi\Documents\data\BDL4_m\model_output.txt",
    Append=False,
    NewOnly=False)

panel_25 = Panel(merge_17)
